% Simulink data dictionary ZC_EVPowerSystem.sldd

DD48VBass_FBSig = Simulink.Bus()
  vout: double
  vin: double

FeedBackSignals = Simulink.Bus()
  DD_FBSig: Bus: DD48VBass_FBSig
  PFC_FBSig: Bus: PFC100Vac_FBSig

PFC100Vac_FBSig = Simulink.Bus()
  vs: double
  vdc: double
  iL: double

PlantSigLog = Simulink.Bus()
  iL: double
  iDC: double
  iDCInv: double
  iLoad48V: double
  iDC48VBass: double
  iDC400VBass: double
  vDC: double
  vInv: double
  vs: double
  v48VBass: double

ControllerSigLog = Simulink.Bus()
  iLRef: double

Duty_Signals = Simulink.Bus()
  PFC_Duty: double, Min=0, Max=1
  DD48v_Duty: double, Min=0, Max=1

LoadSignal = Simulink.Bus()
  Load48V: double
  Load400V: double

PFCRef = Simulink.Bus()
  vInv: double

DDRef = Simulink.Bus()
  vHB: double

CntReference = Simulink.Bus()
  PFC_PowerRef: double
  DD_VoltageRef: double
  elem0: double

HV_PowerLine = Simulink.ConnectionBus()
  P: Connection: foundation.electrical.electrical
  N: Connection: foundation.electrical.electrical

MV_PowerLine = Simulink.ConnectionBus()
  P: Connection: foundation.electrical.electrical
  N: Connection: foundation.electrical.electrical

Configuration = Simulink.ConfigSet(StartTime="0", StopTime="2", FixedStep="1/10000", Solver="odeN", ProdHWDeviceType="Intel->x86-64 (Windows64)", SystemTargetFile="grt.tlc", TargetLang="C")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